# Grasshopper definition createSimpleBoxCase.gh (Grasshopper 0.9.76)
# plug-ins: Python Interpreter

# ---- group: I don't know what to call these
python = PythonScript()  # -> epsilonWallFunction
# ---------- python: Python ----------
import sys
sys.path.append("C:/Users/Administrator/Dropbox/ladybug/Butterfly")
from butterfly.fields import EpsilonWallFunction

epsilonWallFunction = EpsilonWallFunction(value, Cmu, kappa, E)
# ---------- end python ----------
python_2 = PythonScript()  # -> nutkWallFunction
# ---------- python_2: Python ----------
import sys
sys.path.append("C:/Users/Administrator/Dropbox/ladybug/Butterfly")
from butterfly.fields import NutkWallFunction

nutkWallFunction = NutkWallFunction(value, Cmu, kappa, E)
# ---------- end python_2 ----------
python_3 = PythonScript(value="0.01")  # -> kqRWallFunction
# ---------- python_3: Python ----------
import sys
sys.path.append("C:/Users/Administrator/Dropbox/ladybug/Butterfly")
from butterfly.fields import KqRWallFunction

if value:
    kqRWallFunction = KqRWallFunction(value)
# ---------- end python_3 ----------
python_4 = PythonScript(value="(0 0 0)")  # -> fixedValue
# ---------- python_4: Python ----------
import sys
sys.path.append("C:/Users/Administrator/Dropbox/ladybug/Butterfly")
from butterfly.fields import FixedValue

if value:
    fixedValue = FixedValue(value)
# ---------- end python_4 ----------
python_5 = PythonScript()  # -> zeroGradient
# ---------- python_5: Python ----------
import sys
sys.path.append("C:/Users/Administrator/Dropbox/ladybug/Butterfly")
from butterfly.fields import ZeroGradient

zeroGradient = ZeroGradient()
# ---------- end python_5 ----------
python_6 = PythonScript()  # -> calculated
# ---------- python_6: Python ----------
import sys
sys.path.append("C:/Users/Administrator/Dropbox/ladybug/Butterfly")
from butterfly.fields import Calculated

calculated = Calculated()
# ---------- end python_6 ----------

# ----
python_7 = PythonScript(butterflyFolder="C:/Users/Administrator/Dropbox/ladybug/Butterfly")  # -> out
# ---------- python_7: Python ----------
import sys
sys.path.append(butterflyFolder)

try:
    import butterfly
    print "imported buttefly! swoosh swoosh..."
except ImportError:
    raise "Incorrect butterfly folder. Failed to import butterfly!"
# ---------- end python_7 ----------
panel = Panel(python_7)

# ---- group: create your own
python_8 = PythonScript(bcType="patch", U=python_5, p=python_5, k=python_5, epsilon=python_6, nut=python_6)  # -> out, boundaryFields
# ---------- python_8: Python ----------
import sys
sys.path.append("C:/Users/Administrator/Dropbox/ladybug/Butterfly")

import butterfly
from butterfly import boundarycondition
reload(butterfly)
reload(butterfly.boundarycondition)

if not bcType:
    bcType = 'patch'

boundaryFields = boundarycondition.BoundaryCondition(
    bcType, refLevels=None, u=U, p=p, k=k, epsilon=epsilon, nut=nut
)

boundaryFields = boundaryFields.duplicate()
# ---------- end python_8 ----------

# ----
vec = VectorXYZ(XComponent="2", YComponent=0, ZComponent=0)  # -> Vector, Length
python_9 = PythonScript()  # -> out, a
# ---------- python_9: Python ----------
import subprocess, os
os.environ['PATH'] += ';%s' % r'C:\Program Files (x86)\Git'
# os.environ['PATH'] += [;;']
process = subprocess.Popen('boot2docker shellinit',shell=True, stderr=subprocess.PIPE)

for line in process.stderr:
    print line
# ---------- end python_9 ----------
panel_2 = Panel(python_8.boundaryFields)
wall = PythonScript(boundaryFields=python_8.boundaryFields)  # -> BC
# ---------- wall: Python ----------
import sys
sys.path.append("C:/Users/Administrator/Dropbox/ladybug/Butterfly")

import butterfly
from butterfly import boundarycondition as bc

if not refLevels:
    refLevels = (0, 0)

if not boundaryFields:
    BC = bc.BoundaryCondition('patch', refLevels=refLevels)
else:
    boundaryFields.refLevels = refLevels
    BC = boundaryFields.duplicate()
# ---------- end wall ----------
wall_2 = PythonScript(velocityVec=vec.Vector, refLevels="(10, 10)")  # -> inletBC; inputs velocityVec: Vector3d
# ---------- wall_2: Python ----------
import sys
sys.path.append("C:/Users/Administrator/Dropbox/ladybug/Butterfly")

import butterfly
from butterfly import boundarycondition as bc
from butterfly.fields import FixedValue
reload(butterfly)
reload(butterfly.boundarycondition)
#reload(butterfly.fields)

velocityVec = FixedValue(str(tuple(velocityVec)).replace(',', '')) \
              if velocityVec \
              else None

inletBC = bc.InletBoundaryCondition(refLevels=refLevels, u=velocityVec)
# ---------- end wall_2 ----------
wall_3 = PythonScript(refLevels="(5, 5)")  # -> wallBC
# ---------- wall_3: Python ----------
import sys
sys.path.append("C:/Users/Administrator/Dropbox/ladybug/Butterfly")

import butterfly
from butterfly import boundarycondition as bc

reload(butterfly)
reload(butterfly.boundarycondition)

wallBC = bc.WallBoundaryCondition(refLevels=refLevels)
# ---------- end wall_3 ----------
wall_4 = PythonScript(refLevels="(10, 10)")  # -> outletBC
# ---------- wall_4: Python ----------
import sys
sys.path.append("C:/Users/Administrator/Dropbox/ladybug/Butterfly")

import butterfly
from butterfly import boundarycondition as bc
from butterfly.fields import FixedValue

reload(butterfly)
reload(butterfly.boundarycondition)
pressure = FixedValue(pressure) if pressure else None
outletBC = bc.OutletBoundaryCondition(refLevels=refLevels, p=pressure)
# ---------- end wall_4 ----------
jagged = SettingsSpeed()

# ---- group: inlet!
srf = Surface(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)

# ----
srf_2 = Surface(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)
brep = Brep(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)
area = Area(Geometry=srf)  # -> Area, Centroid
preview = CustomPreview(Geometry=[srf_2, srf], Shader=ColourSwatch(SwatchColor=RGBA(136, 191, 255, 77)))
wires = BrepWireframe(Brep=brep, Density=-1)
vdis = VectorDisplay(Anchor=area.Centroid, Vector=vec.Vector)

# ---- group: butterfly face
python_10 = PythonScript(geo=srf, name="west_window", BC=wall_2, meshSet=jagged)  # -> out, BFSrf; inputs geo: list of GeometryBase
# ---------- python_10: Python ----------
import sys
sys.path.append("C:/Users/Administrator/Dropbox/ladybug/Butterfly")

import butterfly
from butterfly.gh import BFSurface

reload(butterfly)
reload(butterfly.gh)

BFSrf = BFSurface(name, geo, BC, meshSet)
# ---------- end python_10 ----------

# ----
python_11 = PythonScript(geo=brep, name="room", BC=wall_3, meshSet=jagged)  # -> out, BFSrf; inputs geo: list of GeometryBase; same code as python_10
python_12 = PythonScript(geo=srf_2, name="east_window", BC=wall_4, meshSet=jagged)  # -> out, BFSrf; inputs geo: list of GeometryBase; same code as python_10
number_slider = Slider(10, range=0..10)
box = DomainBox(Base=PlaneXY(0, 0, 0), X=number_slider, Y=number_slider, Z=number_slider)
python_13 = PythonScript(bbox=box, nDivXYZ="{1,1,1}", gradXYZ="{1,1,1}")  # -> blockMeshDict; inputs bbox: GeometryBase, nDivXYZ: Point3d, gradXYZ: Point3d
# ---------- python_13: Python ----------
# import butterfly
from butterfly.gh import BFSurface, Block
from butterfly.blockMeshDict import BlockMeshDict
#import butterfly
from butterfly.boundarycondition import BoundingBoxBoundaryCondition
#reload(butterfly.blockMeshDict)
#reload(butterfly.boundarycondition)

# create blockMeshDict based on BBox
block = Block(bbox, nDivXYZ, gradXYZ)
bc = BoundingBoxBoundaryCondition()
BBBFSurface = BFSurface('boundingbox', [bbox], bc)
blockMeshDict = BlockMeshDict(1, [BBBFSurface], [block])
# ---------- end python_13 ----------
dom = ConstructDomain(DomainStart="1", DomainEnd="2")

# ---- group: Create and write the case!
python_14 = PythonScript(
    name="study_room_ver_3",
    BFSrfs=flatten([python_11.BFSrf, python_10.BFSrf, python_12.BFSrf]),
    blockMeshDict=python_13,
    globalRefLevel=dom)  # -> out, case; inputs BFSrfs: list, meshGuidePoint: Point3d
# ---------- python_14: Python ----------
import butterfly
from butterfly.core import Case
reload(butterfly)
reload(butterfly.foamfile)
reload(butterfly.helper)
reload(butterfly.core)
#reload(butterfly.snappyHexMeshDict)
#reload(butterfly.fvSchemes)

if not meshGuidePoint:
    meshGuidePoint = blockMeshDict.center
else:
    meshGuidePoint = tuple(meshGuidePoint)

# create OpenFoam Case
case = Case(name, BFSrfs, blockMeshDict, globalRefLevel, meshGuidePoint,
            isSnappyHexMesh=True)

case.createCaseFolders()
case.populateContents()
# ---------- end python_14 ----------

# ---- group: run the analysis if happy with mesh
python_15 = PythonScript(case=python_14.case)  # -> out, a
# ---------- python_15: Python ----------
print case.snappyHexMeshDict.values['geometry']
# ---------- end python_15 ----------

# ----
brep_2 = Brep([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])
python_16 = PythonScript(geo=brep_2, nDivXYZ="{1,1,1}", gradXYZ="{1,1,1}")  # -> out, block; inputs geo: Brep, nDivXYZ: Point3d, gradXYZ: Point3d; disabled
# ---------- python_16: Python ----------
import sys
sys.path.append("C:/Users/Administrator/Dropbox/ladybug/Butterfly")

import butterfly
from butterfly.gh import Block

reload(butterfly)
reload(butterfly.gh)

block = Block(geo, nDivXYZ, gradXYZ)
# ---------- end python_16 ----------
wires_2 = BrepWireframe(Brep=brep_2, Density=-1)
python_17 = PythonScript(name="innerflow_2", blocks=python_16.block)  # -> out, c; inputs BFSrfs: list, blocks: list; disabled
# ---------- python_17: Python ----------
import sys
sys.path.append("C:/Users/Administrator/Dropbox/ladybug/Butterfly")

import butterfly
from butterfly.foamfile import FoamFile
from butterfly.core import Case

reload(butterfly)
reload(butterfly.blockMeshDict)
reload(butterfly.foamfile)
reload(butterfly.core)

c = Case.fromBlocks(BFSrfs, blocks, 1)
c.write(name)
# ---------- end python_17 ----------
panel_3 = Panel(python_17.out)

panel_4 = Panel(python_15.out)

# ---- group: use current development from Chris and Theodore workflow
panel_5 = Panel("result visualization")

# ----
panel_6 = Panel("C:\Users\Administrator\butterfly\study_room\constant\polyMesh")

panel_7 = Panel("C:\Users\Administrator\Dropbox\ladybug\Butterfly\other_files\OpenFOAM_Sample_Files\innerflow\constant\polyMesh")
python_18 = PythonScript(studyFolder="C:\Users\Administrator\butterfly\innerflow_4\2\polyMesh")  # -> out, mesh; disabled
# ---------- python_18: Python ----------
import Rhino as rc
import os

def splitLine(l, t=float):
    return tuple(t(s) for s in l.split('(')[-1].replace(')', '').split())

def OFMeshToRhino(studyFolder):
    if not studyFolder:
        return

    pf = os.path.join(studyFolder, 'points')
    ff = os.path.join(studyFolder, 'faces')
    
    if not os.path.isfile(pf) or not os.path.isfile(ff):
        print "Can't find point and faces file."
        return
        
    # read points
    with open(pf, 'rb') as ptFile:
        for l in xrange(17):
            ptFile.readline()
        
        try:
            # blockMesh
            line = ptFile.readline()
            nPoints = int(line[0])
            pts = tuple(
                       rc.Geometry.Point3d(*pt)
                       for pt in eval(line[1:].replace(" ", ", "))
                       )
        except:
            #snappyHexMesh
            line = ptFile.readline()
            nPoints = int(line)
            ptFile.readline()
            pts = tuple(
                       rc.Geometry.Point3d(*splitLine(ptFile.readline()))
                       for pt in xrange(nPoints)
                )

            
    # read faces
    with open(ff, 'rb') as faceFile:
       for l in xrange(18):
           faceFile.readline()
       
       nFaces = int(faceFile.readline())
       faceFile.readline()
       faces = tuple((splitLine(faceFile.readline(), t=int))
                   for pt in xrange(nFaces)
            )
    
    # create the mesh
    mesh = rc.Geometry.Mesh()

    for p in pts:
        mesh.Vertices.Add(p)

    for face in faces:
        if len(face) < 5:
            mesh.Faces.AddFace(*face)
        elif len(face) == 5:
            mesh.Faces.AddFace(*face[:3])
            mesh.Faces.AddFace(*face[:1] + (face[3:]))
        elif len(face) == 8:
            mesh.Faces.AddFace(*face[:4])
            mesh.Faces.AddFace(*(face[0], face[3], face[4], face[7]))
            mesh.Faces.AddFace(*(face[7], face[4], face[5], face[6]))
        else:
            try:
                mesh.Faces.AddFace(*face[:4])
                mesh.Faces.AddFace(*face[:1] + (face[4:]))
            except:
                msg = "One of the faces has %d vertices." % len(face)
                print msg

    return mesh

mesh = OFMeshToRhino(studyFolder)
# ---------- end python_18 ----------
pt = Point(Point(5.246792205, 3.706414975, 3.184472171))
xz = XZPlane(Origin=pt)
xy = XYPlane(Origin=pt)
yz = YZPlane(Origin=pt)
mesh = Mesh(python_18.mesh)
sec = MeshPlane(Mesh=mesh, Plane=xy)

panel_8 = Panel("C:\Users\Administrator\butterfly\innerflow_3\constant\polyMesh")
python_19 = PythonScript(studyFolder="C:\Users\Administrator\butterfly\study_room\500")  # -> vectors
# ---------- python_19: Python ----------
import Rhino as rc
import os

def splitLine(l, t=float):
    return tuple(t(s) for s in l.split('(')[-1].replace(')', '').split())


def loadVectors(studyFolder):
    pf = os.path.join(studyFolder, 'U')
    
    if not os.path.isfile(pf):
        print "Can't find vector file."
        return
        
    # read vectors
    with open(pf, 'rb') as ptFile:
        for l in xrange(21):
            line = ptFile.readline()       
        nVectors = int(line)
        ptFile.readline()
        vectors = tuple(
                   rc.Geometry.Vector3d(*splitLine(ptFile.readline()))
                   for pt in xrange(nVectors)
            )
    return vectors

vectors = loadVectors(studyFolder)
# ---------- end python_19 ----------
python_20 = PythonScript(studyFolder=panel_6)  # -> pts
# ---------- python_20: Python ----------
import Rhino as rc
import os

def splitLine(l, t=float):
    return tuple(t(s) for s in l.split('(')[-1].replace(')', '').split())


def loadPoints(studyFolder):
    pf = os.path.join(studyFolder, 'points')
    
    if not os.path.isfile(pf):
        print "Can't find point and faces file."
        return
        
    # read points
    with open(pf, 'rb') as ptFile:
        for l in xrange(17):
            ptFile.readline()
        
        try:
            # blockMesh
            line = ptFile.readline()
            nPoints = int(line[0])
            pts = tuple(
                       rc.Geometry.Point3d(*pt)
                       for pt in eval(line[1:].replace(" ", ", "))
                       )
        except:
            #snappyHexMesh
            line = ptFile.readline()
            nPoints = int(line)
            ptFile.readline()
            pts = tuple(
                       rc.Geometry.Point3d(*splitLine(ptFile.readline()))
                       for pt in xrange(nPoints)
                )

    return pts

pts = loadPoints(studyFolder)
# ---------- end python_20 ----------
project = Project(Geometry=python_20, Plane=graft([xy, xz]))  # -> Geometry, Transform
dist = Distance(PointA=project.Geometry, PointB=python_20)
panel_9 = Panel(python_18.out)
smaller = SmallerThan(FirstNumber=dist, SecondNumber="0.2")  # -> SmallerThan, OrEqualTo
cull = CullPattern(List=python_19, CullPattern=smaller.OrEqualTo)
vlen = VectorLength(Vector=cull)
bnd = Bounds(Numbers=vlen)
remap = RemapNumbers(Value=cull, Source=bnd, Target=Domain(1, 0))  # -> Mapped, Clipped
gradient = Gradient(
    LowerLimit=0,
    UpperLimit=1,
    Parameter=remap.Mapped,
    stops=[0: RGB(234, 38, 0), 0.25: RGB(234, 126, 0), 0.5: RGB(254, 244, 84), 0.75: RGB(173, 203, 249), 1: RGB(75, 107, 169)])
cull_2 = CullPattern(List=python_20, CullPattern=smaller.OrEqualTo)
cull_3 = CullPattern(List=python_19, CullPattern=smaller.OrEqualTo)
vdisex = VectorDisplayEx(Point=cull_2, Vector=cull_3, Colour=gradient, Width=Slider(1, range=0..1))
